# Grasshopper definition Kagome relax tests.gh (Grasshopper 1.0.5)
# plug-ins: Kangaroo2 Components

# ---- group: All polylines
crv = Curve(reparameterize([<curve referenced from the Rhino model> x28]))

# ---- group: Boundary polylines
crv_2 = Curve([<curve referenced from the Rhino model> x5])

# ----
project = Project(Geometry=crv_2, Plane=PlaneXY(0, 0, 0))  # -> Geometry, Transform
explode = Explode(Curve=project.Geometry, Recursive=True)  # -> Segments, flatten(Vertices)
cullpt = CullDuplicates(Points=explode.Vertices, Tolerance=0.1, CullMode=3)  # -> Points, Indices, Valence
explode_2 = Explode(Curve=crv, Recursive=True)  # -> Segments, Vertices

# ---- group: play with these
number_slider = Slider(48, range=0..200)
number_slider_2 = Slider(1.07, range=0.5..2)
number_slider_3 = Slider(28, range=0..200)
number_slider_4 = Slider(0, range=0..1)

# ----
rod = Rod(
    Polyline=crv,
    LengthFactor=number_slider_2,
    AngleFactor=number_slider_4,
    AxialStrength=number_slider_3,
    BendStrength=number_slider)
grab = Grab(On=True, Strength=Slider(100, range=0..100), Range=3)  # -> Grab, Anchors
anchor = Anchor(Point=cullpt.Points, Strength=10000)
show = Show(G=explode_2.Segments)
entwine = Entwine(Branch01=show, Branch02=[grab.Grab, anchor, rod], FlattenInputs=True)
solver = Solver(GoalObjects=entwine, Reset=Button(), Threshold=1e-15, Tolerance=0.01, On=Toggle(False))  # -> I, V, O
crv_3 = Curve(solver.O)
