# Grasshopper definition Scissor Prebent.gh (Grasshopper 0.9.76)
# plug-ins: Kangaroo2 Components

# ---- group: Base grid
series = Series(Start=0, Step=Slider(9, range=0..10), Count=Slider(10, range=0..10))
pt = ConstructPoint(XCoordinate=series, YCoordinate=graft(series), ZCoordinate=0)
flip = FlipMatrix(Data=pt)
pline = PolyLine(Vertices=flip, Closed=False)  # -> flatten(Polyline)
pline_2 = PolyLine(Vertices=pt, Closed=False)  # -> flatten(Polyline)

# ---- group: Curved basegrid
bnd = Bounds(Numbers=series)
explode = Explode(Curve=pline_2, Recursive=True)  # -> Segments, Vertices
explode_2 = Explode(Curve=pline, Recursive=True)  # -> Segments, Vertices
number_slider = Slider(0.5, range=0..1)
dedomain = DeconstructDomain(Domain=bnd)  # -> Start, End
len = Length(Curve=explode_2.Segments)
len_2 = Length(Curve=explode.Segments)
pt_2 = ConstructPoint(XCoordinate=[dedomain.Start, dedomain.End], YCoordinate=graft([dedomain.Start, dedomain.End]), ZCoordinate=0)
multiplication = Multiplication(A=len, B=number_slider)
multiplication_2 = Multiplication(A=len_2, B=number_slider)
anchor = Anchor(Point=pt_2, Strength=10000)
length_line = LengthLine(Line=explode.Segments, Length=multiplication_2, Strength=10)
length_line_2 = LengthLine(Line=explode_2.Segments, Length=multiplication, Strength=10)
entwine = Entwine(Branch00=length_line, Branch01=length_line_2, Branch02=anchor, FlattenInputs=True)
zombiesolver = ZombieSolver(GoalObjects=entwine, Threshold=1e-10, Tolerance=0.01, MaxIterations=50000)  # -> I, V, O
unflatten = UnflattenTree(Tree=zombiesolver.O, Guide=entwine)
bang = ExplodeTree(Data=unflatten)  # -> Branch0, Branch1, Branch2
join = JoinCurves(Curves=bang.Branch1, Preserve=False)
join_2 = JoinCurves(Curves=bang.Branch0, Preserve=False)

# ---- group: Pick grid
toggle = BooleanToggle(False)

# ----
c_script = CSharpScript(x=toggle, y=pline_2, z=join_2)  # -> out, A; inputs x: Boolean
# ---------- c_script: C# ----------
    A = x ? y : z;
# ---------- end c_script ----------
c_script_2 = CSharpScript(x=toggle, y=pline, z=join)  # -> out, A; inputs x: Boolean; same code as c_script
crv = Curve(c_script_2.A)
crv_2 = Curve(c_script.A)
explode_3 = Explode(Curve=crv_2, Recursive=True)  # -> Segments, Vertices
X = UnitX(Factor=1)
pl = PlaneNormal(Origin=explode_3.Vertices, ZAxis=X)
amp = Amplitude(Vector=X, Amplitude=Slider(0.2, range=0..1))

# ---- group: Clamped joints
toggle_2 = BooleanToggle(True)

# ----
explode_4 = Explode(Curve=crv, Recursive=True)  # -> Segments, Vertices
move = Move(Geometry=pl, Motion=amp)  # -> Geometry, Transform
c_script_3 = CSharpScript(x=toggle_2, y=pl, z=move.Geometry)  # -> out, A; inputs x: Boolean; same code as c_script
Y = UnitY(Factor=1)
pl_2 = PlaneNormal(Origin=explode_4.Vertices, ZAxis=Y)
pln = Plane(c_script_3.A)
ccx = CurveCurve(CurveA=crv_2, CurveB=graft(crv))  # -> simplify(Points), ParamsA, ParamsB
trim = TrimTree(Tree=ccx.Points, Depth=1)  # -> flatten(Tree)

# ---- group: Beams
pln_2 = Plane(pl_2)
shift = ShiftList(List=pln, Shift=1, Wrap=Toggle(False))
shift_2 = ShiftList(List=pln_2, Shift=1, Wrap=Toggle(False))
short = ShortestList(ListA=pln, ListB=shift, TrimMode=2)  # -> ListA, ListB
short_2 = ShortestList(ListA=pln_2, ListB=shift_2, TrimMode=2)  # -> ListA, ListB
beam = Beam(StartFrame=short.ListA, EndFrame=short.ListB, E=1, A=1, Ix=1, Iy=1, GJ=1)
beam_2 = Beam(StartFrame=short_2.ListA, EndFrame=short_2.ListB, E=1, A=1, Ix=1, Iy=1, GJ=1)

# ----
cp = ClosestPoint(Point=trim, Cloud=flatten(pln_2))  # -> ClosestPoint, CPIndex, Distance
cp_2 = ClosestPoint(Point=trim, Cloud=flatten(pln))  # -> ClosestPoint, CPIndex, Distance
number_slider_2 = Slider(0, range=0..100)
xy = XYPlane(Origin=cp.ClosestPoint)
xy_2 = XYPlane(Origin=cp_2.ClosestPoint)
Z = UnitZ(Factor=1)
item = ListItem(List=xy_2, Index=number_slider_2, Wrap=True)
item_2 = ListItem(List=xy, Index=number_slider_2, Wrap=True)

# ---- group: Scissor joints
c_script_4 = CSharpScript(
    PlaneA=xy_2,
    PlaneB=xy,
    VA=Z,
    VB=Z,
    Strength=Slider(58, range=0..100),
    Reference="C:\Users\iNaslund\AppData\Roaming\Grasshopper\Libraries\KangarooSolver.dll")  # -> out, A; inputs PlaneA: Plane, PlaneB: Plane, VA: Vector3d, VB: Vector3d, Strength: Double
# ---------- c_script_4: C# ----------
    A = new AlignAxis(PlaneA, PlaneB, VA, VB, Strength);
# ---------- c_script_4: C# additional code ----------
  public class AlignAxis : GoalObject
  {
    Vector3d VAR,VBR; //the vectors relative to the initial planes
    double _slackLength;


    public AlignAxis(Plane PA, Plane PB, Vector3d VA, Vector3d VB, double k)
    {
      PPos = new Point3d[2] { PA.Origin,PB.Origin };
      InitialOrientation = new Plane[2] { PA,PB };

      _slackLength = PA.Origin.DistanceTo(PB.Origin);

      Move = new Vector3d[2];
      Torque = new Vector3d[2];

      Weighting = new double[2] { k,k };
      TorqueWeighting = new double[2] { k,k };

      VAR = VA;
      VAR.Transform(Transform.ChangeBasis(Plane.WorldXY, PA));
      VBR = VB;
      VBR.Transform(Transform.ChangeBasis(Plane.WorldXY, PB));
    }

    public override void Calculate(List<KangarooSolver.Particle> p)
    {
      Plane PA = p[PIndex[0]].Orientation;
      Plane PB = p[PIndex[1]].Orientation;
      //translation
      Vector3d V = (PB.Origin - PA.Origin);
      double currLength = V.Length;
      double stretch = currLength - _slackLength;
      Vector3d axMove = 0.5 * (V / currLength) * stretch;
      Move[0] = axMove;
      Move[1] = -axMove;

      
      Move[0] = 0.5 * V;
      Move[1] = -0.5 * V;

      //rotation (making use of small angle approximation)
      Vector3d VAN = VAR;
      Vector3d VBN = VBR;
      VAN.Transform(Transform.ChangeBasis(PA, Plane.WorldXY));
      VBN.Transform(Transform.ChangeBasis(PB, Plane.WorldXY));

      Vector3d rot = 0.5 * (Vector3d.CrossProduct(VAN, VBN));

      Torque[0] = rot;
      Torque[1] = -rot;
    }
  }
# ---------- end c_script_4 ----------

# ----
grab = Grab(On=True, Strength=1, Range=3)  # -> Grab, Anchors
entwine_2 = Entwine(Branch00=[beam, beam_2], Branch01=c_script_4.A, Branch02=grab.Grab, FlattenInputs=True)
solver = Solver(GoalObjects=entwine_2, Reset=Button(), Threshold=1e-15, Tolerance=0.1, On=Toggle(False))  # -> I, V, O
bang_2 = ExplodeTree(Data=solver.O)  # -> Branch0, Branch1
c_script_5 = CSharpScript(x=graft(bang_2.Branch0))  # -> out, P0, P1, TX1, TX2, TY1, TY2, Twist
# ---------- c_script_5: C# ----------
    List<object> data = x as List<object>;
    P0 = data[0];
    P1 = data[1];
    TX1 = data[2];
    TX2 = data[3];
    TY1 = data[4];
    TY2 = data[5];
    Twist = data[6];
# ---------- end c_script_5 ----------
c_script_6 = CSharpScript(P0=c_script_5.P0, P1=c_script_5.P1, x=Slider(0.462, range=0..1), y=Slider(0.537, range=0..1))  # -> out, M; inputs x: Double, y: Double
# ---------- c_script_6: C# ----------
    Plane PA = (Plane) P0;
    Plane PB = (Plane) P1;

    Mesh M1 = new Mesh();

    Point3d[] Verts = new Point3d[16]{
      PA.PointAt(x, y),PA.PointAt(-x, y),PA.PointAt(-x, -y),PA.PointAt(x, -y),
      PB.PointAt(x, y),PB.PointAt(-x, y),PB.PointAt(-x, -y),PB.PointAt(x, -y),
      PA.PointAt(x, y),PA.PointAt(-x, y),PA.PointAt(-x, -y),PA.PointAt(x, -y),
      PB.PointAt(x, y),PB.PointAt(-x, y),PB.PointAt(-x, -y),PB.PointAt(x, -y)};
    M1.Vertices.AddVertices(Verts);

    M1.Faces.AddFace(1, 5, 4, 0);
    M1.Faces.AddFace(10, 14, 13, 9);
    M1.Faces.AddFace(3, 7, 6, 2);
    M1.Faces.AddFace(8, 12, 15, 11);

    M1.Normals.ComputeNormals();

    M = M1;
# ---------- end c_script_6 ----------
preview = CustomPreview(Geometry=c_script_6.M, Shader=ColourSwatch(SwatchColor=RGB(255, 255, 255)))
