# Grasshopper definition swivel_example2.gh (Grasshopper 1.0.5)
# plug-ins: Kangaroo2 Components

Y = UnitY(Factor=Slider(0, range=0..1))
C = Curve(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)
move = Move(Geometry=C, Motion=Y)  # -> Geometry, Transform
C_2 = Curve(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)
C_3 = Curve(move.Geometry)
divlength = DivideLength(Curve=C_3, Length=2)  # -> Points, Tangents, Parameters
divlength_2 = DivideLength(Curve=C_2, Length=2)  # -> Points, Tangents, Parameters
end = EndPoints(Curve=C_3)  # -> Start, End
pline = PolyLine(Vertices=divlength_2.Points, Closed=False)
pline_2 = PolyLine(Vertices=divlength.Points, Closed=False)
end_2 = EndPoints(Curve=C_2)  # -> Start, End
explode = Explode(Curve=pline, Recursive=True)  # -> Segments, Vertices
explode_2 = Explode(Curve=pline_2, Recursive=True)  # -> Segments, Vertices
pframe = PerpFrame(Curve=reparameterize(explode.Segments), Parameter=1)
pframe_2 = PerpFrame(Curve=reparameterize(explode_2.Segments), Parameter=1)
pframe_3 = PerpFrame(Curve=reparameterize(explode.Segments), Parameter=0)
pframe_4 = PerpFrame(Curve=reparameterize(explode_2.Segments), Parameter=0)
item = ListItem(List=pframe, Index=4, Wrap=True)
item_2 = ListItem(List=pframe_2, Index=4, Wrap=True)
Z = UnitZ(Factor=1)
xy = XYPlane(Origin=item)
xy_2 = XYPlane(Origin=item_2)
xy_3 = XYPlane(Origin=[end.Start, end.End])
xy_4 = XYPlane(Origin=end_2.Start)
c_script = CSharpScript(
    PlaneA=xy_2,
    PlaneB=xy,
    VA=Z,
    VB=Z,
    Strength=10,
    Reference="C:\Program Files\Rhino 6\Plug-ins\Grasshopper\Components\KangarooSolver.dll")  # -> out, A; inputs PlaneA: Plane, PlaneB: Plane, VA: Vector3d, VB: Vector3d, Strength: Double
# ---------- c_script: C# ----------
    A = new AlignAxis(PlaneA, PlaneB, VA, VB, Strength);
# ---------- c_script: C# additional code ----------
  public class AlignAxis : GoalObject
  {
    Vector3d VAR,VBR; //the vectors relative to the initial planes

    public AlignAxis(Plane PA, Plane PB, Vector3d VA, Vector3d VB, double k)
    {
      PPos = new Point3d[2] { PA.Origin,PB.Origin };
      InitialOrientation = new Plane[2] { PA,PB };

      Move = new Vector3d[2];
      Torque = new Vector3d[2];

      Weighting = new double[2] { k,k };
      TorqueWeighting = new double[2] { k,k };

      VAR = VA;
      VAR.Transform(Transform.ChangeBasis(Plane.WorldXY, PA));
      VBR = VB;
      VBR.Transform(Transform.ChangeBasis(Plane.WorldXY, PB));
    }

    public override void Calculate(List<KangarooSolver.Particle> p)
    {
      Plane PA = p[PIndex[0]].Orientation;
      Plane PB = p[PIndex[1]].Orientation;
      //translation
      Vector3d V = 0.5 * (PB.Origin - PA.Origin);
      Move[0] = V;
      Move[1] = -V;

      //rotation (making use of small angle approximation)
      Vector3d VAN = VAR;
      Vector3d VBN = VBR;
      VAN.Transform(Transform.ChangeBasis(PA, Plane.WorldXY));
      VBN.Transform(Transform.ChangeBasis(PB, Plane.WorldXY));

      Vector3d rot = 0.5 * (Vector3d.CrossProduct(VAN, VBN));

      Torque[0] = rot;
      Torque[1] = -rot;
    }
  }
# ---------- end c_script ----------
support = Support(
    Frame=xy_3,
    X=Toggle(True),
    Y=Toggle(True),
    Z=Toggle(True),
    XX=Toggle(False),
    YY=Toggle(False),
    ZZ=Toggle(False),
    Strength=100)
support_2 = Support(
    Frame=xy_4,
    X=Toggle(False),
    Y=Toggle(False),
    Z=Toggle(True),
    XX=Toggle(False),
    YY=Toggle(False),
    ZZ=Toggle(False),
    Strength=100)
beam = Beam(StartFrame=pframe_3, EndFrame=pframe, E=1, A=1, Ix=1, Iy=1, GJ=1)
beam_2 = Beam(StartFrame=pframe_4, EndFrame=pframe_2, E=1, A=1, Ix=1, Iy=1, GJ=1)
grab = Grab(On=Toggle(True), Strength=1, Range=3)  # -> Grab, Anchors
entwine = Entwine(Branch00=[beam, beam_2], Branch01=[support, support_2, c_script.A, grab.Grab], FlattenInputs=True)
solver = Solver(GoalObjects=entwine, Reset=Button(), Threshold=1e-15, Tolerance=0.1, On=Toggle(True))  # -> I, V, O
bang = ExplodeTree(Data=solver.O)  # -> Branch0, Branch1
c_script_2 = CSharpScript(x=graft(bang.Branch0))  # -> out, P0, P1, TX1, TX2, TY1, TY2, Twist
# ---------- c_script_2: C# ----------
    List<object> data = x as List<object>;
    P0 = data[0];
    P1 = data[1];
    TX1 = data[2];
    TX2 = data[3];
    TY1 = data[4];
    TY2 = data[5];
    Twist = data[6];
# ---------- end c_script_2 ----------
c_script_3 = CSharpScript(P0=c_script_2.P0, P1=c_script_2.P1, x=Slider(0.462, range=0..1), y=Slider(0.537, range=0..1))  # -> out, M; inputs x: Double, y: Double
# ---------- c_script_3: C# ----------
    Plane PA = (Plane) P0;
    Plane PB = (Plane) P1;

    Mesh M1 = new Mesh();

    Point3d[] Verts = new Point3d[16]{
      PA.PointAt(x, y),PA.PointAt(-x, y),PA.PointAt(-x, -y),PA.PointAt(x, -y),
      PB.PointAt(x, y),PB.PointAt(-x, y),PB.PointAt(-x, -y),PB.PointAt(x, -y),
      PA.PointAt(x, y),PA.PointAt(-x, y),PA.PointAt(-x, -y),PA.PointAt(x, -y),
      PB.PointAt(x, y),PB.PointAt(-x, y),PB.PointAt(-x, -y),PB.PointAt(x, -y)};
    M1.Vertices.AddVertices(Verts);

    M1.Faces.AddFace(1, 5, 4, 0);
    M1.Faces.AddFace(10, 14, 13, 9);
    M1.Faces.AddFace(3, 7, 6, 2);
    M1.Faces.AddFace(8, 12, 15, 11);

    M1.Normals.ComputeNormals();

    M = M1;
# ---------- end c_script_3 ----------
preview = CustomPreview(
    Geometry=c_script_3.M,
    Shader={diffuse=RGB(0, 128, 128), emission=RGB(0, 0, 0), shine=0, specular=RGB(255, 255, 255), transparency=0})
